# Grasshopper definition udp_gh_.gh (Grasshopper 1.0.7)
# plug-ins: KUKA|prc - parametric robot control

c_script = CSharpScript()  # -> out, A
# ---------- c_script: C# ----------
    string[] Str = x.Split(new string[] {"!"}, StringSplitOptions.RemoveEmptyEntries);
# ---------- end c_script ----------
brep = Brep(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)
brep_2 = Brep(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)
custom_tool = CustomToolKUKAPrc(
    CustomToolGeometry=brep_2,
    toolid=6,
    toolvala=0,
    toolvalb=0,
    toolvalc=0,
    toolvalx=0,
    toolvaly=0,
    toolvalz=0,
    valuesset=True)
custom_tool_2 = CustomToolKUKAPrc(
    CustomToolGeometry=brep,
    toolid=6,
    toolvala=0,
    toolvalb=0,
    toolvalc=0,
    toolvalx=0,
    toolvaly=0,
    toolvalz=0,
    valuesset=True)
int = Integer()
filter = StreamFilter(Gate=int, Stream0=custom_tool_2, Stream1=custom_tool)
