# Grasshopper definition udp_python_.gh (Grasshopper 1.0.7)

c_script = CSharpScript()  # -> out, A
# ---------- c_script: C# ----------
   
    string[] Str = x.Split(new string[] {"!"}, StringSplitOptions.RemoveEmptyEntries);
# ---------- end c_script ----------
brep = Brep(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)
brep_2 = Brep(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)

dom = ConstructDomain(DomainStart=Slider(-30, range=-180..100), DomainEnd=Slider(30, range=0..1000))

dom_2 = ConstructDomain(DomainStart=Slider(45, range=-180..1000), DomainEnd=Slider(160, range=0..1000))

# ---- group: 8
relay = Relay()

# ----
pdecon = Deconstruct(Point=relay)  # -> XComponent, YComponent, ZComponent
dom_3 = ConstructDomain(DomainStart=Slider(110, range=0..1000), DomainEnd=Slider(620, range=0..1000))
dom_4 = ConstructDomain(DomainStart=Slider(110, range=0..1000), DomainEnd=Slider(620, range=0..1000))
remap = RemapNumbers(Value=pdecon.XComponent, Source=dom_4, Target=dom)  # -> Mapped, Clipped
remap_2 = RemapNumbers(Value=pdecon.YComponent, Source=dom_3, Target=dom_2)  # -> Mapped, Clipped
number_slider = Slider(50, range=0..100)
dom_5 = ConstructDomain(DomainStart=Slider(120, range=0..1000), DomainEnd=number_slider)
dom_6 = ConstructDomain(DomainStart=number_slider, DomainEnd=Slider(280, range=0..1000))
remap_3 = RemapNumbers(Source=dom_6, Target=dom_5)  # -> Mapped, Clipped
