# Grasshopper definition udp_gh_.gh (Grasshopper 1.0.7)
# plug-ins: gHowl, KUKA|prc - parametric robot control

udp = UDPReceiver(Address="192.168.1.107", Port=Slider(5653, range=0..10000), Pattern=0)  # -> Info, Data
c_script = CSharpScript()  # -> out, position, scale, Ball; inputs x: String
# ---------- c_script: C# ----------
    string[] Str = x.Split(new string[] {"!"}, StringSplitOptions.RemoveEmptyEntries);
    position = Str[0];
    scale = Str[1];
    
    string[] center = Str[0].Split(new string[] {","}, StringSplitOptions.RemoveEmptyEntries);
    Point3d pt = new Point3d(double.Parse(center[0]), double.Parse(center[1]), double.Parse(center[2]));
    
    Sphere ball = new Sphere(pt, double.Parse(Str[1]));
    
    Ball = ball;
# ---------- end c_script ----------
panel = Panel(udp.Data)
brep = Brep(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)
brep_2 = Brep(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)
c_script_2 = CSharpScript(x=panel)  # -> out, rl, ud, open; inputs x: String
# ---------- c_script_2: C# ----------
    string[] Str = x.Split(new string[] {"!"}, StringSplitOptions.RemoveEmptyEntries);

    rl = Str[0];
    ud = Str[1];
    
    if(Str[2] == (-1).ToString())
    {
      open = 0;
    }
    else
    {
      open = 1;
    }
# ---------- end c_script_2 ----------
geo = Geometry(c_script.Ball)
pt = Point(c_script.position)
filter = StreamFilter(Gate=c_script_2.open, Stream0=brep_2, Stream1=brep)
panel_2 = Panel(c_script.position)
panel_3 = Panel(c_script.scale)
pdecon = Deconstruct(Point=pt)  # -> XComponent, YComponent, ZComponent
dom = ConstructDomain(DomainStart=Slider(5, range=0..10), DomainEnd=Slider(-5, range=-10..-5))
pt_2 = ConstructPoint(XCoordinate=c_script_2.rl, YCoordinate=c_script_2.ud, ZCoordinate=Slider(622, range=0..1000))
remap = RemapNumbers(Value=pdecon.ZComponent, Source=dom, Target=Domain(0, 1))  # -> Mapped, Clipped
custom_tool = CustomToolKUKAPrc(
    CustomToolGeometry=filter,
    toolid=6,
    toolvala=0,
    toolvalb=0,
    toolvalc=0,
    toolvalx=0,
    toolvaly=0,
    toolvalz=0,
    valuesset=True)
xy = XYPlane(Origin=pt_2)
hsl = ColourHSL(Alpha=1, Hue=remap.Mapped, Saturation=1, Luminance=0.5)
ptp_move = PTPMovementKUKAPrc(TargetAsPlane=xy, extaxenabled=False, interpolation="C_PTP")
panel_4 = Panel(hsl)
kr4_r600 = AgilusKR4R600Robot(infiniterot=False)
udp_2 = UDPSender(Address="192.168.1.107", Port=Slider(5656, range=0..10000), Pattern=0, Data=panel_4)
panel_5 = Panel(udp_2)
kuka_prc = KUKAPrcCORE(
    KUKAPrcCommands=ptp_move,
    Tool=custom_tool,
    Robot=kr4_r600,
    PRC_BaseExpose=False,
    PRC_SaveNameExpose=False,
    PRCsettings="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")  # -> RobotGeometry, AnalysisOutput
