# Grasshopper definition udp_python_.gh (Grasshopper 1.0.7)
# plug-ins: gHowl, KUKA|prc - parametric robot control

udp = UDPReceiver(Address="192.168.1.107", Port=Slider(5065, range=0..10000), Pattern=0)  # -> Info, Data
relay = Relay()
c_script = CSharpScript()  # -> out, A; inputs x: String
# ---------- c_script: C# ----------
   
    string[] Str = x.Split(new string[] {"!"}, StringSplitOptions.RemoveEmptyEntries);
# ---------- end c_script ----------
panel = Panel(udp.Data)
c_script_2 = CSharpScript(x=relay)  # -> out, hand_point; inputs x: String
# ---------- c_script_2: C# ----------
    List<Point3d> pts = new List<Point3d>();
    
    string[] Str = x.Split(new string[] {"!"}, StringSplitOptions.RemoveEmptyEntries);
    foreach(string i in Str)
    {
      string[] Str_pos = i.Split(new string[] {","}, StringSplitOptions.RemoveEmptyEntries);
      Point3d pt = new Point3d(double.Parse(Str_pos[0]),double.Parse(Str_pos[1]), 0);
      pts.Add(pt);
    }
    hand_point = pts;
# ---------- end c_script_2 ----------
panel_2 = Panel(relay)
c_script_3 = CSharpScript(x=udp.Data)  # -> out, body_point; inputs x: String
# ---------- c_script_3: C# ----------
    List<Point3d> pts = new List<Point3d>();

    string[] Str = x.Split(new string[] {"!"}, StringSplitOptions.RemoveEmptyEntries);
    foreach(string i in Str)
    {
      string[] Str_pos = i.Split(new string[] {","}, StringSplitOptions.RemoveEmptyEntries);
      Point3d pt = new Point3d(double.Parse(Str_pos[0]), double.Parse(Str_pos[1]), double.Parse(Str_pos[2]));
      pts.Add(pt);
    }
    body_point = pts;
# ---------- end c_script_3 ----------
panel_3 = Panel("""4
8""")
panel_4 = Panel("""11
12""")
panel_5 = Panel("""11
13""")
item = ListItem(List=c_script_2.hand_point, Index=panel_3, Wrap=True)
item_2 = ListItem(List=c_script_3.body_point, Index=panel_4, Wrap=True)
item_3 = ListItem(List=c_script_3.body_point, Index=panel_5, Wrap=True)

dom = ConstructDomain(DomainStart=Slider(-30, range=-180..100), DomainEnd=Slider(30, range=0..1000))

dom_2 = ConstructDomain(DomainStart=Slider(45, range=-180..1000), DomainEnd=Slider(160, range=0..1000))

item_4 = ListItem(List=item, Index=0, Wrap=True)  # -> Item, Item1
sph = Sphere(Base=item, Radius=Slider(13, range=0..100))
item_5 = ListItem(List=item_2, Index=0, Wrap=True)  # -> Item, Item1
item_6 = ListItem(List=item_3, Index=0, Wrap=True)  # -> Item, Item1
xy = XYPlane(Origin=item_5.Item)
yz = YZPlane(Origin=item_6.Item)
pdecon = Deconstruct(Point=item_4.Item1)  # -> XComponent, YComponent, ZComponent
dom_3 = ConstructDomain(DomainStart=Slider(110, range=0..1000), DomainEnd=Slider(620, range=0..1000))
dom_4 = ConstructDomain(DomainStart=Slider(110, range=0..1000), DomainEnd=Slider(620, range=0..1000))
cp = PlaneClosestPoint(Point=item_5.Item1, Plane=xy)  # -> Point, UVPoint, Distance
dist = Distance(PointA=item_4.Item, PointB=item_4.Item1)
cp_2 = PlaneClosestPoint(Point=item_6.Item1, Plane=yz)  # -> Point, UVPoint, Distance
smaller = SmallerThan(FirstNumber=dist, SecondNumber=Slider(50, range=0..100))  # -> SmallerThan, OrEqualTo
vec2pt = Vector2Pt(PointA=item_5.Item, PointB=cp.Point, Unitize=False)  # -> Vector, Length
remap = RemapNumbers(Value=pdecon.XComponent, Source=dom_4, Target=dom)  # -> Mapped, Clipped
remap_2 = RemapNumbers(Value=pdecon.YComponent, Source=dom_3, Target=dom_2)  # -> Mapped, Clipped
X = UnitX(Factor=1)
brep = Brep(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)
vec2pt_2 = Vector2Pt(PointA=item_6.Item, PointB=cp_2.Point, Unitize=False)  # -> Vector, Length
brep_2 = Brep(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)
Y = UnitY(Factor=1)
number_slider = Slider(50, range=0..100)
int = Integer(smaller.OrEqualTo)
angle = Angle(VectorA=X, VectorB=vec2pt.Vector, Plane=xy)  # -> Angle, Reflex
number_slider_2 = Slider(0, range=-180..180)
filter = StreamFilter(Gate=int, Stream0=brep, Stream1=brep_2)
angle_2 = Angle(VectorA=Y, VectorB=vec2pt_2.Vector, Plane=yz)  # -> Angle, Reflex
deg = Degrees(Radians=angle.Reflex)
custom_tool = CustomToolKUKAPrc(
    CustomToolGeometry=filter,
    toolid=6,
    toolvala=0,
    toolvalb=0,
    toolvalc=0,
    toolvalx=0,
    toolvaly=0,
    toolvalz=0,
    valuesset=True)
kr3_r540 = AgilusKR3R540Robot(infiniterot=False)
dom_5 = ConstructDomain(DomainStart=Slider(120, range=0..1000), DomainEnd=number_slider)
deg_2 = Degrees(Radians=angle_2.Reflex)
dom_6 = ConstructDomain(DomainStart=number_slider, DomainEnd=Slider(280, range=0..1000))
python = GhPythonScript(x=deg)  # -> out, a
# ---------- python: Python ----------
if x >90:
    a = x - 360
else:
    a = x
# ---------- end python ----------
axis_move = AXISMovementKUKAPrc(
    Axis1=remap.Mapped,
    Axis2=Slider(-90, range=-100..-90),
    Axis3=remap_2.Mapped,
    Axis4=number_slider_2,
    Axis5=number_slider_2,
    Axis6=number_slider_2,
    extaxenabled=False,
    interpolation="C_PTP")
remap_3 = RemapNumbers(Value=deg_2, Source=dom_6, Target=dom_5)  # -> Mapped, Clipped
number_slider_3 = Slider(0, range=-180..180)
panel_6 = Panel(python.a)
kuka_prc = KUKAPrcCORE(
    KUKAPrcCommands=axis_move,
    Tool=custom_tool,
    Robot=kr3_r540,
    PRC_BaseExpose=False,
    PRC_SaveNameExpose=False,
    PRCsettings="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")  # -> RobotGeometry, AnalysisOutput
kr3_r540_2 = AgilusKR3R540Robot(infiniterot=False)
axis_move_2 = AXISMovementKUKAPrc(
    Axis1=panel_6,
    Axis2=Slider(-90, range=-100..-90),
    Axis3=remap_3.Mapped,
    Axis4=number_slider_3,
    Axis5=number_slider_3,
    Axis6=number_slider_3,
    extaxenabled=False,
    interpolation="C_PTP")
kuka_prc_2 = KUKAPrcCORE(
    KUKAPrcCommands=axis_move_2,
    Robot=kr3_r540_2,
    PRC_BaseExpose=False,
    PRC_SaveNameExpose=False,
    PRCsettings="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")  # -> RobotGeometry, AnalysisOutput
